# Dynamo graph MEP_Coordinate - Copy (2).dyn "MEP_Coordinate" (Dynamo 3.6.2.11575)

# group: Pipe Fittings
string = StringInput("Pipe Fittings")
byName = Category.ByName(name=string)
all_elements_of_category = ElementsOfCategory(Category=byName)
getLocation = Element.GetLocation(element=all_elements_of_category)

# group: Formura
python_script = Python(IN[0]=getLocation)  # CPython3
# ---------- python_script.python (33 lines) ----------
import clr
clr.AddReference('ProtoGeometry')
from Autodesk.DesignScript.Geometry import *

# รับค่า Geometry (Points) เข้ามาที่ IN[0] โดยตรง
input_geometry = IN[0]

def extract_coordinates(geo_list):
    results = []
    
    # ตรวจสอบว่าเป็น List หรือไม่ ถ้าไม่ใช่ให้ทำเป็น List เพื่อให้ใช้ Loop ได้
    if not isinstance(geo_list, list):
        geo_list = [geo_list]
        
    for item in geo_list:
        if item is None:
            continue
            
        # รองรับกรณีที่ข้อมูลเป็น List ซ้อน List (Nested List)
        if isinstance(item, list):
            results.extend(extract_coordinates(item))
        else:
            try:
                # ดึงค่า X, Y, Z จาก Point โดยตรงใน Python
                results.append((item.X, item.Y, item.Z))
            except:
                # ป้องกันกรณี Element บางตัวส่งค่าเป็น Geometry รูปแบบอื่นที่ไม่ใช่ Point
                pass
                
    return results

# ประมวลผลลัพธ์
OUT = extract_coordinates(input_geometry)
# ----------------------------------------

# group: Input Parameter
e_w_survey_point = CodeBlock { "E_Coordinate"; "N_Coordinate"; }
setp_e_servay_point = Element.SetParameterByName(element=all_elements_of_category, parameterName=e_w_survey_point.out0)  # unwired: value
setp_n_servay_point = Element.SetParameterByName(element=all_elements_of_category, parameterName=e_w_survey_point.out1)  # unwired: value
code_block = CodeBlock(pts=python_script) { pts[0]; }
code_block_2 = CodeBlock(pts=python_script) { pts[1]; }

watch = Watch(setp_e_servay_point)
watch_2 = Watch(setp_n_servay_point)
