# Dynamo graph MEP_Coordinate - Copy.dyn (Dynamo 3.6.2.11575)

# group: Pipe Fittings
string = StringInput("Pipe Fittings")
byName = Category.ByName(name=string)
all_elements_of_category = ElementsOfCategory(Category=byName)
getLocation = Element.GetLocation(element=all_elements_of_category)

# group: Formura
python_script = Python(IN[0]=getLocation)  # CPython3
# ---------- python_script.python (27 lines) ----------
import clr
clr.AddReference('ProtoGeometry')
from Autodesk.DesignScript.Geometry import *

input_geometry = IN[0]

def extract_coordinates(geo_list):
    results = []
    if not isinstance(geo_list, list):
        geo_list = [geo_list]
        
    for item in geo_list:
        if item is None:
            results.append([0.0, 0.0, 0.0])
            continue
            
        if isinstance(item, list):
            results.append(extract_coordinates(item))
        else:
            try:
                results.append([item.X, item.Y, item.Z])
            except:
                results.append([0.0, 0.0, 0.0])
                
    return results

OUT = extract_coordinates(input_geometry)
# ----------------------------------------

# group: Input Parameter
e_w_survey_point = CodeBlock { "E_Coordinate"; "N_Coordinate"; }
code_block = CodeBlock { p[0]..for_each..p; }  # unwired: p, for_each
setp_e_servay_point = Element.SetParameterByName(element=all_elements_of_category, parameterName=e_w_survey_point.out0, value=code_block)
code_block_2 = CodeBlock { p[1]..for_each..p; }  # unwired: p, for_each
setp_n_servay_point = Element.SetParameterByName(element=all_elements_of_category, parameterName=e_w_survey_point.out1, value=code_block_2)

watch = Watch(setp_e_servay_point)
watch_2 = Watch(setp_n_servay_point)
