# Dynamo graph MEP_Coordinate.dyn (Dynamo 3.6.2.11575)
# Fixed Multi-Output Coordinates without Code Blocks

string = StringInput("Pipe Fittings")
byName = Category.ByName(name=string)
all_elements_of_category = ElementsOfCategory(Category=byName)
e_w_survey_point = CodeBlock { "E_Coordinate"; "N_Coordinate"; }
getLocation = Element.GetLocation(element=all_elements_of_category)
python_script = Python(IN[0]=getLocation)  # CPython3
# ---------- python_script.python (31 lines) ----------
import clr
clr.AddReference('ProtoGeometry')
from Autodesk.DesignScript.Geometry import *

input_geometry = IN[0]

def process_geometry(geo):
    x_coords = []
    y_coords = []
    
    # ฟังก์ชันทะลวง List และดักจับค่าว่าง (None)
    def extract(item):
        if item is None:
            x_coords.append(0.0)
            y_coords.append(0.0)
        elif isinstance(item, list):
            for sub_item in item:
                extract(sub_item)
        else:
            try:
                x_coords.append(item.X)
                y_coords.append(item.Y)
            except:
                x_coords.append(0.0)
                y_coords.append(0.0)
                
    extract(input_geometry)
    return [x_coords, y_coords] # ส่งออกเป็น List ใหญ่ที่มี 2 ก้อนย่อย

# ส่งค่าออกพอร์ต OUT (ช่องเดียว)
OUT = process_geometry(input_geometry)
# ----------------------------------------
code_block = CodeBlock(data=python_script) { E_Value = data[0]; N_Value = data[1]; }
setp_e_servay_point = Element.SetParameterByName(element=all_elements_of_category, parameterName=e_w_survey_point.out0, value=code_block.E_Value)
watch = Watch(setp_e_servay_point)
setp_n_servay_point = Element.SetParameterByName(element=all_elements_of_category, parameterName=e_w_survey_point.out1, value=code_block.N_Value)
watch_2 = Watch(setp_n_servay_point)
