# Dynamo graph Home.dyn (Dynamo 3.6.2.11575)

string = StringInput("CNT_MEP-ELE-ELV")
boolean = BoolSelector(true)
python_script = Python(IN[0]=string, IN[1]=boolean)  # CPython3
# ---------- python_script.python (159 lines) ----------
import clr
import math
clr.AddReference("RevitAPI")
from Autodesk.Revit.DB import *
clr.AddReference("RevitServices")
from RevitServices.Persistence import DocumentManager
from RevitServices.Transactions import TransactionManager

doc = DocumentManager.Instance.CurrentDBDocument
active_view_id = doc.ActiveView.Id

target_workset = str(IN[0]).strip() if IN[0] else ""

view_equipments = FilteredElementCollector(doc, active_view_id)\
    .OfCategory(BuiltInCategory.OST_ElectricalEquipment)\
    .WhereElementIsNotElementType().ToElements()
view_conduits = FilteredElementCollector(doc, active_view_id)\
    .OfCategory(BuiltInCategory.OST_Conduit)\
    .WhereElementIsNotElementType().ToElements()

if target_workset:
    manholes = [e for e in view_equipments
                if doc.GetWorksetTable().GetWorkset(e.WorksetId).Name == target_workset]
else:
    manholes = list(view_equipments)

def mm_to_ft(mm):
    return UnitUtils.ConvertToInternalUnits(mm, UnitTypeId.Millimeters)

def ft_to_mm(ft):
    return UnitUtils.ConvertFromInternalUnits(ft, UnitTypeId.Millimeters)

def eid(element_id):
    return getattr(element_id, "Value",
           getattr(element_id, "IntegerValue", str(element_id)))

def endpoint_in_bbox(pt, mn, mx):
    return (mn.X <= pt.X <= mx.X and
            mn.Y <= pt.Y <= mx.Y and
            mn.Z <= pt.Z <= mx.Z)

def get_floor_z(manhole, origin):
    """หาพื้นบ่อจริงจาก face ที่หันขึ้น (+Z) และมี area มากที่สุด"""
    try:
        opt = Options()
        opt.ComputeReferences = True
        opt.DetailLevel = ViewDetailLevel.Fine
        geom = manhole.get_Geometry(opt)
        floor_candidates = {}

        def scan(geo_elems):
            for obj in geo_elems:
                if isinstance(obj, Solid) and obj.Volume > 0:
                    for face in obj.Faces:
                        normal = face.ComputeNormal(UV(0.5, 0.5))
                        if normal.IsAlmostEqualTo(XYZ.BasisZ):
                            fz = face.Evaluate(UV(0.5, 0.5)).Z
                            if fz < (origin.Z - 0.5):
                                key = round(fz, 4)
                                floor_candidates[key] = floor_candidates.get(key, 0) + face.Area
                elif isinstance(obj, GeometryInstance):
                    scan(obj.GetInstanceGeometry())

        scan(geom)
        if floor_candidates:
            return max(floor_candidates, key=floor_candidates.get)
    except:
        pass
    # fallback: BBox.Min.Z
    return manhole.get_BoundingBox(None).Min.Z

def set_val(manhole, param_name, value_ft):
    p = manhole.LookupParameter(param_name)
    if not p or p.IsReadOnly:
        return
    if value_ft < 0:
        value_ft = 0.0
    val_mm = round(ft_to_mm(value_ft))
    p.Set(mm_to_ft(val_mm))

TransactionManager.Instance.EnsureInTransaction(doc)

results = []

for manhole in manholes:
    if not manhole.LookupParameter("CNT_Connection 1"):
        continue
    try:
        transform  = manhole.GetTransform()
        origin     = transform.Origin
        bbox       = manhole.get_BoundingBox(None)

        # ขอบเขตบ่อ = BBox พอดี + buffer 50mm
        buf     = mm_to_ft(5.0)
        lim_min = XYZ(bbox.Min.X - buf, bbox.Min.Y - buf, bbox.Min.Z - buf)
        lim_max = XYZ(bbox.Max.X + buf, bbox.Max.Y + buf, bbox.Max.Z + buf)

        # หาพื้นบ่อจริงด้วย Geometry
        base_z = get_floor_z(manhole, origin)

        main_s  = [[], [], [], []]
        extra_s = [[], [], [], []]

        for conduit in view_conduits:
            if not hasattr(conduit.Location, "Curve"):
                continue
            curve = conduit.Location.Curve
            p0 = curve.GetEndPoint(0)
            p1 = curve.GetEndPoint(1)

            # เลือก endpoint ที่อยู่ใน BBox บ่อ
            in0 = endpoint_in_bbox(p0, lim_min, lim_max)
            in1 = endpoint_in_bbox(p1, lim_min, lim_max)
            if not in0 and not in1:
                continue
            pt = p0 if in0 else p1

            # classify extra ด้วยชื่อ type
            c_type    = doc.GetElement(conduit.GetTypeId())
            type_name = c_type.get_Parameter(
                BuiltInParameter.SYMBOL_NAME_PARAM).AsString().lower()
            is_extra  = "without duct" in type_name

            # แยกด้านด้วย angle (รองรับบ่อหมุนทุกองศา)
            lpt       = transform.Inverse.OfPoint(pt)
            angle_deg = math.degrees(math.atan2(lpt.Y, lpt.X))

            if   angle_deg >= 135 or angle_deg <= -135: side = 0  # Connection 1
            elif -135 < angle_deg <= -45:               side = 1  # Connection 2
            elif  -45 < angle_deg <=  45:               side = 2  # Connection 3
            else:                                        side = 3  # Connection 4

            # depth = ระยะจากพื้นบ่อขึ้นมาหา conduit
            depth = pt.Z - base_z

            if is_extra:
                extra_s[side].append(depth)
            else:
                main_s[side].append(depth)

        # เขียน parameter (ใช้ min = ต่ำสุด ตาม design intent)
        for i, label in enumerate(["1", "2", "3", "4"]):
            mv = min(main_s[i])  if main_s[i]  else 0.0
            ev = min(extra_s[i]) if extra_s[i] else 0.0
            set_val(manhole, f"CNT_Connection {label}",       mv)
            set_val(manhole, f"CNT_Connection {label} Extra", ev)

        results.append(
            f"✅ [{eid(manhole.Id)}] "
            f"main={[round(ft_to_mm(min(s)) if s else 0) for s in main_s]} "
            f"extra={[round(ft_to_mm(min(s)) if s else 0) for s in extra_s]}"
        )

    except Exception as ex:
        results.append(f"❌ [{eid(manhole.Id)}] {ex}")

TransactionManager.Instance.TransactionTaskDone()

OUT = "\n".join(results)
# ----------------------------------------
string_2 = StringInput("CNT_MEP-ELE-ELV")  # frozen
boolean_2 = BoolSelector(true)  # frozen
python_script_2 = Python(IN[0]=string_2, IN[1]=boolean_2)  # CPython3; frozen
# ---------- python_script_2.python (202 lines) ----------
import clr
import math

clr.AddReference("RevitAPI")
import Autodesk
from Autodesk.Revit.DB import *

clr.AddReference("RevitServices")
import RevitServices
from RevitServices.Persistence import DocumentManager
from RevitServices.Transactions import TransactionManager

doc = DocumentManager.Instance.CurrentDBDocument
active_view_id = doc.ActiveView.Id 

target_workset = IN[0]
if target_workset: target_workset = str(target_workset).strip()
else: target_workset = ""

force_refresh = IN[1] 

def get_workset_name(element):
    try: return doc.GetWorksetTable().GetWorkset(element.WorksetId).Name
    except: return ""

view_equipments = FilteredElementCollector(doc, active_view_id)\
                 .OfCategory(BuiltInCategory.OST_ElectricalEquipment)\
                 .WhereElementIsNotElementType()\
                 .ToElements()

view_conduits = FilteredElementCollector(doc, active_view_id)\
               .OfCategory(BuiltInCategory.OST_Conduit)\
               .WhereElementIsNotElementType()\
               .ToElements()

view_fittings = FilteredElementCollector(doc, active_view_id)\
               .OfCategory(BuiltInCategory.OST_ConduitFitting)\
               .WhereElementIsNotElementType()\
               .ToElements()

if target_workset != "":
    manholes = [e for e in view_equipments if get_workset_name(e) == target_workset]
else:
    manholes = view_equipments

TransactionManager.Instance.EnsureInTransaction(doc)
success_count = 0
skipped_count = 0

for manhole in manholes:
    if not manhole.LookupParameter("CNT_Connection 1"): continue
    if not hasattr(manhole, "Location"): continue

    transform = manhole.GetTransform()
    origin = transform.Origin

    opt = Options()
    opt.ComputeReferences = True
    opt.DetailLevel = ViewDetailLevel.Fine
    geomElem = manhole.get_Geometry(opt)
    floor_candidates = {}

    def find_inner_floors(geometry_elements):
        for obj in geometry_elements:
            if isinstance(obj, Solid) and obj.Volume > 0:
                for face in obj.Faces:
                    normal = face.ComputeNormal(UV(0.5, 0.5))
                    if normal.IsAlmostEqualTo(XYZ.BasisZ):
                        face_z = face.Evaluate(UV(0.5, 0.5)).Z
                        if face_z < (origin.Z - 0.5):
                            z_key = round(face_z, 4)
                            floor_candidates[z_key] = floor_candidates.get(z_key, 0) + face.Area
            elif isinstance(obj, GeometryInstance):
                find_inner_floors(obj.GetInstanceGeometry())

    find_inner_floors(geomElem)
    if floor_candidates: manhole_bottom_z = max(floor_candidates, key=floor_candidates.get)
    else: manhole_bottom_z = manhole.get_BoundingBox(None).Min.Z

    main_side1, main_side2, main_side3, main_side4 = [], [], [], []
    extra_side1, extra_side2, extra_side3, extra_side4 = [], [], [], []
    
    has_fitting_s1, has_fitting_s2, has_fitting_s3, has_fitting_s4 = False, False, False, False

    # 1. สแกนหาท่อ (Conduit)
    for conduit in view_conduits:
        if not hasattr(conduit.Location, "Curve"): continue 
            
        curve = conduit.Location.Curve
        pt_start = curve.GetEndPoint(0)
        pt_end = curve.GetEndPoint(1)
        dist_start = pt_start.DistanceTo(origin)
        dist_end = pt_end.DistanceTo(origin)
        
        # 🔥 [แก้บั๊ก XYZ] ลบแกนตรงๆ ทีละแกน ป้องกัน Python 3 งง
        if dist_start > dist_end:
            closest_pt = pt_end
            conduit_vec = XYZ(pt_end.X - pt_start.X, pt_end.Y - pt_start.Y, pt_end.Z - pt_start.Z)
        else:
            closest_pt = pt_start
            conduit_vec = XYZ(pt_start.X - pt_end.X, pt_start.Y - pt_end.Y, pt_start.Z - pt_end.Z)
            
        if min(dist_start, dist_end) > 10.0: continue 
            
        is_extra = False
        conduit_name = conduit.Name.lower()
        conduit_type = doc.GetElement(conduit.GetTypeId())
        type_name = conduit_type.get_Parameter(BuiltInParameter.SYMBOL_NAME_PARAM).AsString().lower() if conduit_type else ""
        
        if "without duct" in conduit_name or "without duct" in type_name:
            is_extra = True 
            
        local_vec = transform.Inverse.OfVector(conduit_vec)
        conduit_z = closest_pt.Z
        
        if abs(local_vec.X) >= abs(local_vec.Y):
            if local_vec.X > 0:
                if is_extra: extra_side1.append(conduit_z)
                else: main_side1.append(conduit_z)
            else:
                if is_extra: extra_side3.append(conduit_z)
                else: main_side3.append(conduit_z)
        else:
            if local_vec.Y > 0:
                if is_extra: extra_side2.append(conduit_z)
                else: main_side2.append(conduit_z)
            else:
                if is_extra: extra_side4.append(conduit_z)
                else: main_side4.append(conduit_z)

    # 2. สแกนหา Fitting
    for fitting in view_fittings:
        if not hasattr(fitting, "Location") or not fitting.Location: continue
        
        loc = fitting.Location
        pt = None
        if hasattr(loc, "Point"): pt = loc.Point
        elif hasattr(loc, "Curve") and loc.Curve: pt = loc.Curve.Evaluate(0.5, True)
        
        if not pt: continue
        if pt.DistanceTo(origin) > 10.0: continue 
        
        # 🔥 [แก้บั๊ก XYZ] ลบแกนตรงๆ ทีละแกน ป้องกัน Python 3 งง
        fitting_vec = XYZ(origin.X - pt.X, origin.Y - pt.Y, origin.Z - pt.Z)
        local_vec = transform.Inverse.OfVector(fitting_vec)
        
        if abs(local_vec.X) >= abs(local_vec.Y):
            if local_vec.X > 0: has_fitting_s1 = True
            else: has_fitting_s3 = True
        else:
            if local_vec.Y > 0: has_fitting_s2 = True
            else: has_fitting_s4 = True

    def get_lowest_offset(z_list, base_z, has_fitting):
        if len(z_list) == 0: 
            if has_fitting: 
                return None 
            return 0.0 
        return min(z_list) - base_z

    val_m1 = get_lowest_offset(main_side1, manhole_bottom_z, has_fitting_s1)
    val_m2 = get_lowest_offset(main_side2, manhole_bottom_z, has_fitting_s2)
    val_m3 = get_lowest_offset(main_side3, manhole_bottom_z, has_fitting_s3)
    val_m4 = get_lowest_offset(main_side4, manhole_bottom_z, has_fitting_s4)

    val_e1 = get_lowest_offset(extra_side1, manhole_bottom_z, has_fitting_s1)
    val_e2 = get_lowest_offset(extra_side2, manhole_bottom_z, has_fitting_s2)
    val_e3 = get_lowest_offset(extra_side3, manhole_bottom_z, has_fitting_s3)
    val_e4 = get_lowest_offset(extra_side4, manhole_bottom_z, has_fitting_s4)

    def set_param_direct(element, param_name, value):
        if value is None: 
            return 
            
        param = element.LookupParameter(param_name)
        if param and param.IsReadOnly == False:
            if value == 0.0:
                new_internal_val = 0.0
            else:
                val_mm_rounded = round(value * 304.8, 0)
                new_internal_val = val_mm_rounded / 304.8
            
            if abs(param.AsDouble() - new_internal_val) > 0.001: 
                param.Set(new_internal_val)

    try:
        set_param_direct(manhole, "CNT_Connection 1", val_m1)
        set_param_direct(manhole, "CNT_Connection 2", val_m2)
        set_param_direct(manhole, "CNT_Connection 3", val_m3)
        set_param_direct(manhole, "CNT_Connection 4", val_m4)
        
        set_param_direct(manhole, "CNT_Connection 1 Extra", val_e1)
        set_param_direct(manhole, "CNT_Connection 2 Extra", val_e2)
        set_param_direct(manhole, "CNT_Connection 3 Extra", val_e3)
        set_param_direct(manhole, "CNT_Connection 4 Extra", val_e4)
        success_count += 1
    except:
        skipped_count += 1 

TransactionManager.Instance.TransactionTaskDone()

OUT = f"✅ สำเร็จ (แก้บั๊ก XYZ สำหรับ Python 3): {success_count} บ่อ | ⚠️ ข้ามบ่อ Error: {skipped_count} บ่อ"
# ----------------------------------------
